# Grasshopper definition 250429_Geometry Generator.gh (Grasshopper 1.0.8)
# plug-ins: jSwan, RhinoCodePluginGH, Pufferfish, Kangaroo2 Components

pipeline = GeometryPipeline(
    GroupByLayer=False,
    GroupByType=False,
    IncludeHidden=False,
    IncludeLocked=True,
    LayerFilter="Perimeter",
    NameFilter="*",
    SublayerFiltering=True,
    TypeFilter=4)
pipeline_2 = GeometryPipeline(
    GroupByLayer=False,
    GroupByType=False,
    IncludeHidden=False,
    IncludeLocked=True,
    LayerFilter="Beams",
    NameFilter="*",
    SublayerFiltering=True,
    TypeFilter=4)
pipeline_3 = GeometryPipeline(
    GroupByLayer=False,
    GroupByType=False,
    IncludeHidden=False,
    IncludeLocked=True,
    LayerFilter="Beams",
    NameFilter="*",
    SublayerFiltering=True,
    TypeFilter=1)
pipeline_4 = GeometryPipeline(
    GroupByLayer=False,
    GroupByType=False,
    IncludeHidden=False,
    IncludeLocked=True,
    LayerFilter="Holes",
    NameFilter="*",
    SublayerFiltering=True,
    TypeFilter=1073741848)
pipeline_5 = GeometryPipeline(
    GroupByLayer=False,
    GroupByType=False,
    IncludeHidden=False,
    IncludeLocked=True,
    LayerFilter="Walls",
    NameFilter="*",
    SublayerFiltering=True,
    TypeFilter=4)
crv = Curve(flatten([pipeline_2, pipeline_5, pipeline]))
pt = Point(flatten(pipeline_3))
explode = Explode(Curve=crv, Recursive=True)  # -> flatten(Segments), Vertices
mcx = MultipleCurves(Curves=explode.Segments)  # -> Points, IndexA, IndexB, ParamA, ParamB
listdexs = ListIndices(List=explode.Segments)
difference = SetDifference(SetA=listdexs, SetB=flatten([mcx.IndexA, mcx.IndexB]))
py3 = Python3Script(iA=mcx.IndexA, iB=mcx.IndexB, tA=mcx.ParamA, tB=mcx.ParamB, crvs=explode.Segments)  # -> out, shattered, beam_group; inputs iA: list of Int32, iB: list of Int32, tA: list of Double, tB: list of Double, crvs: list of Curve
# ---------- py3: Python ----------
import Rhino.Geometry as rg

shattered = []
beam_group = []

for i in range(len(crvs)):
    shatter_params = []
    for j in range(len(iA)): # index of first curve intersection
        if iA[j] == i:
            shatter_params.append(tA[j])
    for j in range(len(iB)): # index of second curve intersection
        if iB[j] == i:
            shatter_params.append(tB[j])

    split_curves = crvs[i].Split(shatter_params)
    shattered.extend(split_curves)
    beam_group.extend([i+1] * len(split_curves))
# ---------- end py3 ----------
item = ListItem(List=explode.Segments, Index=difference, Wrap=True)
explode_2 = Explode(Curve=py3.shattered, Recursive=True)  # -> flatten(Segments), flatten(Vertices)
dupln = RemoveDuplicateLines(Lines=flatten([explode_2.Segments, item]), Tolerance=0.01)
duppt = RemoveDuplicatePts(Points=explode_2.Vertices, Tolerance=0.01)
explode_3 = Explode(Curve=pipeline_5, Recursive=True)  # -> flatten(Segments), Vertices
explode_4 = Explode(Curve=pipeline, Recursive=True)  # -> flatten(Segments), Vertices
clean = CleanTree(RemoveNulls=True, RemoveInvalid=True, RemoveEmpty=False, Tree=dupln)
split = SplitList(List=clean, Index=Slider(97, range=0..205))  # -> ListA, ListB
clean_2 = CleanTree(RemoveNulls=True, RemoveInvalid=True, RemoveEmpty=False, Tree=duppt)
crv_2 = Curve(split.ListB)
py3_2 = Python3Script(
    lines=clean,
    line_id=py3.beam_group,
    vertices=clean_2,
    columns=pt,
    walls=explode_3.Segments,
    perimeter=explode_4.Segments,
    holes=pipeline_4)  # -> out, simplify(positions), simplify(connectivities), simplify(column_i), simplify(wall_i), simplify(holes_i), simplify(perimeter_i); inputs lines: list of Line, line_id: list, vertices: list of Point3d, columns: list of Point3d, walls: list of Line, perimeter: list of Line, holes: list of Brep
# ---------- py3_2: Python ----------
import Rhino.Geometry as rg
import ghpythonlib.treehelpers as th

tol = 1e-3
positions = []
connectivities = []
column_i = []
wall_i = []
perimeter_i = []
holes_i = []

for i in range(len(vertices)):
    vertex = vertices[i]
    positions.append([vertex.X,vertex.Y,0])
    if walls != None:
        for wall in walls:
            if wall.DistanceTo(vertex, True) < tol:
                wall_i.append(i+1)
                break

if holes != None:
    for hole in holes:
        hole_vector = []
        hole_vertices = [vertex.Location for vertex in hole.Vertices]
        for hole_vertex in hole_vertices:
            for (i, vertex) in enumerate(vertices):
                if vertex.DistanceTo(hole_vertex) < tol:
                    hole_vector.append(i+1)
                    break
        holes_i.append(hole_vector)

if columns != None:
    for i in range(len(columns)):
        on_endpoint = False
        for j in range(len(positions)):
            if (abs(columns[i].X - positions[j][0]) < tol and abs(columns[i].Y - positions[j][1]) < tol):
                column_i.append(j+1)
                on_endpoint = True
        if not on_endpoint:
            for j, line in enumerate(lines):
                distance_to = line.DistanceTo(columns[i], True)
                if distance_to < tol:
                    # Save old line ID BEFORE popping
                    old_id = line_id[j]

                    # Break the line
                    line_a = rg.Line(line.From, columns[i])
                    line_b = rg.Line(columns[i], line.To)

                    # Remove the old line and its ID
                    lines.pop(j)
                    line_id.pop(j)

                    # Insert two new lines and reuse the SAME old ID for both
                    lines.insert(j, line_b)
                    lines.insert(j, line_a)
                    line_id.insert(j, old_id)
                    line_id.insert(j+1, old_id)
                    # add node
                    positions.append([columns[i].X,columns[i].Y,0])
                    column_i.append(len(positions))
                    break

for i in range(len(lines)):
    line = lines[i]
    connectivity = []
    for j in range(len(positions)):
        if (abs(line.From[0] - positions[j][0]) < tol and abs(line.From[1] - positions[j][1]) < tol):
            connectivity.append(j+1)
        elif (abs(line.To[0] - positions[j][0]) < tol and abs(line.To[1] - positions[j][1]) < tol):
            connectivity.append(j+1)
    if len(connectivity) > 1:
        connectivity.append(line_id[i])
        connectivities.append(connectivity)
    for perimeter_line in perimeter:
        if perimeter_line.MinimumDistanceTo(line.From) < tol and perimeter_line.MinimumDistanceTo(line.To) < tol:
            perimeter_i.append(i+1)

positions = th.list_to_tree(positions)
connectivities = th.list_to_tree(connectivities)
column_i = th.list_to_tree(column_i)
holes_i = th.list_to_tree(holes_i)
perimeter_i = th.list_to_tree(perimeter_i)
# ---------- end py3_2 ----------
num = Number(py3_2.positions)
num_2 = Number(py3_2.connectivities)
num_3 = Number(py3_2.column_i)
num_4 = Number(py3_2.wall_i)
num_5 = Number(py3_2.holes_i)
num_6 = Number(py3_2.perimeter_i)
item_2 = ListItem(List=clean, Index=num_6, Wrap=True)
panel = Panel("""from
to
id""")
panel_2 = Panel("""x
y
z""")
rejsonkv = SerializeKeysAndValues(Key=panel, Value=num_2)  # -> flatten(JSON)
rejsonkv_2 = SerializeKeysAndValues(Key=panel_2, Value=num)  # -> flatten(JSON)
rejsonkv_3 = SerializeKeysAndValues(Key="hole", Value=num_5)  # -> flatten(JSON)
rejsonkv_4 = SerializeKeysAndValues(Key="positions", Value=rejsonkv_2)
rejsonkv_5 = SerializeKeysAndValues(Key="columns_i", Value=num_3)
rejsonkv_6 = SerializeKeysAndValues(Key="wall_i", Value=num_4)
rejsonkv_7 = SerializeKeysAndValues(Key="connectivities", Value=rejsonkv)
rejsonkv_8 = SerializeKeysAndValues(Key="perimeter_i", Value=num_6)
rejsonkv_9 = SerializeKeysAndValues(Key="holes_i", Value=rejsonkv_3)  # -> flatten(JSON)
jmerge = MergeJson(SourceJson=rejsonkv_4, OverrideJson=rejsonkv_7)
jmerge_2 = MergeJson(SourceJson=jmerge, OverrideJson=rejsonkv_5)
jmerge_3 = MergeJson(SourceJson=jmerge_2, OverrideJson=rejsonkv_6)
jmerge_4 = MergeJson(SourceJson=jmerge_3, OverrideJson=rejsonkv_9)
jmerge_5 = MergeJson(SourceJson=jmerge_4, OverrideJson=rejsonkv_8)

panel_3 = Panel("/Users/tashahirt/Dropbox (MIT)/_MIT/DS Research/2024_Slab Design Factors/Geometries/validation/")
py3_3 = Python3Script(content=jmerge_5, folder=panel_3, filename="school", dump=Button())  # -> out, a; inputs content: String, folder: String, filename: String, dump: Boolean
# ---------- py3_3: Python ----------
import json
import Grasshopper as gh

destination = folder + "/" + filename + ".json"

if dump:
    f = open(destination, "w")
    json.dump(content,f)
    f.close()
# ---------- end py3_3 ----------
